vi "index.gviweb"   [LabVIEW NXG 5.0.0]
panel controls:
  "Timezone": string
  "LV Enabled": bool = TRUE
  "LV TZ Update": bool
  "LV OS TZ Update": bool = TRUE
  "Pi OS TZ Update": bool = TRUE
  "LV OS Enabled": bool = TRUE
  "Pi OS Enabled": bool = TRUE
panel indicators:
  "Connected?": bool
  "LabVIEW Time": string
  "WebSockets URL": string
  "Last Error": string
  "LabVIEW OS Time": string
  "PI OS Time": string
types:
  T1 = cluster{"WebSockets URL": string, "WebSocket Session": u32, "Connected?": bool, "Message In": string, "Message Out": string, "LV TZ Update?": bool, "LV Time Update?": bool, "LV Time": string, "LV OS TZ Update?": bool, "LV OS Time Update?": bool, "LV OS Time": string, "Pi OS TZ Update?": bool, "Pi OS Time Update?": bool, "Pi OS Time": string}
uses:
  JKI::Library::JKI State Machine::Add State(s) to Queue.gvi
  JKI::Library::JKI State Machine::Parse State Queue.gvi
  NI::G Core::Error::Build Error Cluster.gvi
  WebApp::GetHostname.jsli::GetHostname
  NI::WebSockets::Close WebSocket.gvi
  NI::G Core::Error::Clear Error Cluster.gvi
  NI::WebSockets::Open WebSocket.gvi
  NI::WebSockets::Read String.gvi
  NI::WebSockets::Write String.gvi
diagram:
  call "Add State(s) to Queue.gvi"(State(s) in ("")="Macro: Initialize") -> (States Out=w1)
  # This has been modified from the JKI State Machine NXG 3.0 available at https://github.com/JKISoftware/JKI-State-Machine-NXG/tree/master/source.  Instead of building a package the required VIs have been added to this project.  The items not supported by a Web VI have been removed.
  # = State Syntax =
  # StateCategory: State >> Argument
  # Line Terminator: Line feed
  # Example:
  # UI: Help >> About
  #
  # Where "UI" is the state category
  # Where "Help" is the state
  # Where "About" is the argument
  # Other Examples:
  # App Data: Initialize
  # UI: Initialize
  # Help >> About
  #
  # = Commenting =
  # To add a comment use "//" or "#" and all text to the right will be ignored
  # Commenting Example:
  # UI: Initialize // This initializes the UI
  # # This whole line is a comment
  # // Another comment line
  # For instructions on how to use the JKI State Machine, examples and video tutorials, visit:
  # http://jki.net/state-machine/
  #
  # JKI State Machine™
  # http://jki.net/state-machine/
  # Copyright (C) 2005-2018, JKI <info@jki.net>
  # ALL RIGHTS RESERVED
  s1 = uninitialised  # shift register
  s2 = uninitialised  # shift register
  s3 = w1  # shift register
  while {
    call "Parse State Queue.gvi"(State Queue=s3, Error In (no error)=s2) -> (Remaining States=w2, Current State=w3, Arguments=w4)
    w5 = 10  # Timeout
    # JKI State Machine NXG 3.0				Template Copyright © 2018 JKI	 - http://jki.net/state-machine
    # -1 =
    # wait
    # forever
    case (w3) ignore case {
      frame "", "Event Structure", "Idle" {
        # executes when the state queue is empty
        event (timeout = w5) {
          on "Timeout" {
            Property Node(instance in=s1) -> ("Connected?"=w10)
            Select(s=w10, t="Comm: Read", f="Comm: Connecting") -> w11
            # Timeout Frame
            # (this will only execute if the Event Structure timeout is >= 0)
            call "Add State(s) to Queue.gvi"(State(s) in Front ("")=w11, State(s) in ("")=w2, State(s) at Back ("")="UI: Update") -> (States Out=w7)
            w6 = s2
            w9 = s1
          }
          on "Timezone" Value changed {
            call "Add State(s) to Queue.gvi"(State(s) in Front ("")="UI: Process Timezone", State(s) in ("")=w2) -> (States Out=w7)
            w6 = s2
            w9 = s1
          }
          on "LV Enabled" Value changed; "LV OS Enabled" Value changed; "LV OS TZ Update" Value changed; "LV TZ Update" Value changed; "Pi OS Enabled" Value changed; "Pi OS TZ Update" Value changed {
            Event Data() -> ("New Value"=w12, "Control Reference"=w13)
            Property Node(instance in=w13) -> ("Label"=w14)
            Property Node(instance in=w14) -> ("Text"=w15)
            Format Into String(formatString="UI: Process Boolean >> %s,%s", w15, w12) -> w16
            call "Add State(s) to Queue.gvi"(State(s) in Front ("")=w16, State(s) in ("")=w2) -> (States Out=w7)
            w6 = s2
            w9 = s1
          }
        }
        w8 = default
      }
      frame "---------- Core ----------" {
        # Do not put any code in this frame.
        # (it is a separator no-op)
        call "Add State(s) to Queue.gvi"(State(s) in ("")=w2) -> (States Out=w7)
        w6 = s2
        w8 = default
        w9 = s1
      }
      frame Default {
        # Do not delete, rename, or modify this frame.
        # (this is used to capture unhandled states and typos)
        call "Add State(s) to Queue.gvi"(State(s) in ("")=w2) -> (States Out=w7)
        Format Into String(formatString="Software Exception: Unhandled State \"%s\".", errIn=s2, w3) -> (outString=w17, errOut=w18)
        # Handle mistyped state name (developer tool)
        call "Build Error Cluster.gvi"(code="Generic error"(42), description=w17, error in=w18, include call chain=TRUE) -> (error out=w6)
        w8 = default
        w9 = s1
      }
      frame "Error Handler" {
        # Handle any errors here.
        # You can also output any states to clean-up after errors occur
        call "Add State(s) to Queue.gvi"(State(s) in Front ("")="/* Post Error States", State(s) in ("")=w2) -> (States Out=w7)
        Property Node(instance in=s2) -> ("code"=w19, "source"=w20)
        # Unhandled Error -- Display it
        Get Current Time() -> (current time=w21)
        Format Into String(formatString="%<%c>T\nCode: %d\n%s", w21, w19, w20) -> w22
        $"Last Error" <- w22
        # Clear error
        w6 = no error
        w8 = default
        w9 = s1
      }
      frame "Exit" {
        # Do not put any code in this frame.
        # (No errors that occur here will be handled.)
        call "Add State(s) to Queue.gvi"(State(s) in ("")=w2) -> (States Out=w7)
        w23 = TRUE  # Stop
        w6 = s2
        w8 = w23
        w9 = s1
      }
      frame "---------- Data ----------" {
        # Do not put any code in this frame.
        # (It is a separator no-op. You can make a copy of this frame to create a new Data frame)
        call "Add State(s) to Queue.gvi"(State(s) in ("")=w2) -> (States Out=w7)
        w6 = s2
        w8 = default
        w9 = s1
      }
      frame "Data: Initialize" {
        # Initialize the shift-register data, here.
        # (data names are defined by what you wire into the bundle function)
        call "Add State(s) to Queue.gvi"(State(s) in ("")=w2) -> (States Out=w7)
        # Data names and types of shift register data are defined by this bundle.
        # Add new data here.
        w24 = T1 {"LV Time Update?"=TRUE, "LV OS TZ Update?"=TRUE, "LV OS Time Update?"=TRUE, "Pi OS TZ Update?"=TRUE, "Pi OS Time Update?"=TRUE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}
        w6 = s2
        w8 = default
        w9 = w24
      }
      frame "Data: Cleanup" {
        # Cleanup any data and references, here.
        # (this is called automatically, by the Macro: Exit)
        call "Add State(s) to Queue.gvi"(State(s) in ("")=w2) -> (States Out=w7)
        w6 = s2
        w8 = default
        w9 = s1
      }
      frame "---------- UI ----------" {
        # Do not put any code in this frame.
        # (It is a separator no-op. You can make a copy of this frame to create a new UI frame)
        call "Add State(s) to Queue.gvi"(State(s) in ("")=w2) -> (States Out=w7)
        w6 = s2
        w8 = default
        w9 = s1
      }
      frame "UI: Initialize" {
        # Initialize the User Interface, here.
        # (this is called automatically, by the Macro: Init)
        call "Add State(s) to Queue.gvi"(State(s) in ("")=w2) -> (States Out=w7)
        $"Last Error" <- ""
        w6 = s2
        w8 = default
        w9 = s1
      }
      frame "UI: Update" {
        # Update the User Interface, here.
        # (this is called automatically, by the Macro: Init and during Timeout)
        call "Add State(s) to Queue.gvi"(State(s) in ("")=w2) -> (States Out=w7)
        Property Node(instance in=s1) -> ("WebSockets URL"=w25, "Connected?"=w26, "LV Time"=w27, "LV OS Time"=w28, "Pi OS Time"=w29)
        $"WebSockets URL" <- w25
        $"Connected?" <- w26
        $"LabVIEW Time" <- w27
        $"LabVIEW OS Time" <- w28
        $"PI OS Time" <- w29
        w6 = s2
        w8 = default
        w9 = s1
      }
      frame "UI: Process Timezone" {
        # UI: Process Timezone
        # (Process the Timezone change from the UI.)
        call "Add State(s) to Queue.gvi"(State(s) in ("")=w2, State(s) at Back ("")="Comm: Write") -> (States Out=w7)
        Property Node(instance in=reference to "Timezone", error in=s2) -> ("Value"=w30, error out=w31)
        w32 = cluster{"Command": string, "Timezone": string} {all zero or empty}
        Property Node(instance in=w32, "Command"="Timezone", "Timezone"=w30) -> (instance out=w33)
        Flatten To Json(anything=w33, error in (no error)=w31) -> (JSON string=w34, error out=w6)
        Property Node(instance in=s1, "Message Out"=w34) -> (instance out=w9)
        w8 = default
      }
      frame "UI: Process Boolean" {
        # UI: Process Boolean
        # (Process a boolean change from the UI.)
        call "Add State(s) to Queue.gvi"(State(s) in ("")=w2, State(s) at Back ("")="Comm: Write") -> (States Out=w7)
        Search Or Split String(search string/char=",", string=w4) -> (match + rest of string=w35, substring before match=w36)
        String Subset(offset (0)=1, string=w35) -> w37
        Scan From String(inputString=w37, default=FALSE) -> (out0=w38)
        w39 = cluster{"Command": string, "Enabled?": bool} {all zero or empty}
        Property Node(instance in=w39, "Command"=w36, "Enabled?"=w38) -> (instance out=w40)
        Flatten To Json(anything=w40, error in (no error)=s2) -> (JSON string=w41, error out=w6)
        Property Node(instance in=s1, "Message Out"=w41) -> (instance out=w9)
        w8 = default
      }
      frame "UI: Process LV Time" {
        # UI: Process LV Time
        # (Process the LV Time Update.)
        call "Add State(s) to Queue.gvi"(State(s) in ("")=w2) -> (States Out=w7)
        Property Node(instance in=s1) -> ("Message In"=w42, instance out=w43)
        Unflatten From Json(JSON string=w42, error in (no error)=s2, path=["LV Time"], type and defaults=string "") -> (error out=w6, value=w44)
        Property Node(instance in=w43, "LV Time"=w44) -> (instance out=w9)
        w8 = default
      }
      frame "UI: Process LV OS Time" {
        # UI: Process LV OS Time
        # (Process the LV OS Time Update.)
        call "Add State(s) to Queue.gvi"(State(s) in ("")=w2) -> (States Out=w7)
        Property Node(instance in=s1) -> ("Message In"=w45, instance out=w46)
        Unflatten From Json(JSON string=w45, error in (no error)=s2, path=["LV OS Time"], type and defaults=string "") -> (error out=w6, value=w47)
        Property Node(instance in=w46, "LV OS Time"=w47) -> (instance out=w9)
        w8 = default
      }
      frame "UI: Process Pi OS Time" {
        # UI: Process Pi OS Time
        # (Process the Pi OS Time Update.)
        call "Add State(s) to Queue.gvi"(State(s) in ("")=w2) -> (States Out=w7)
        Property Node(instance in=s1) -> ("Message In"=w48, instance out=w49)
        Unflatten From Json(JSON string=w48, error in (no error)=s2, path=["Pi OS Time"], type and defaults=string "") -> (error out=w6, value=w50)
        Property Node(instance in=w49, "Pi OS Time"=w50) -> (instance out=w9)
        w8 = default
      }
      frame "---------- Macro ----------" {
        # Do not put any code in this frame.
        # (It is a separator no-op. You can make a copy of this frame to create a new Macro frame)
        call "Add State(s) to Queue.gvi"(State(s) in ("")=w2) -> (States Out=w7)
        w6 = s2
        w8 = default
        w9 = s1
      }
      frame "Macro: Initialize" {
        # Initialization Macro
        # (This is called once, when the VI starts)
        w51 = "Data: Initialize\nUI: Initialize\nUI: Update\nComm: Initialize\nUI: Update"
        call "Add State(s) to Queue.gvi"(State(s) in Front ("")=w51, State(s) in ("")=w2) -> (States Out=w7)
        w6 = s2
        w8 = default
        w9 = s1
      }
      frame "Macro: Exit" {
        # Exit Macro
        # (This is called once, when the VI exits)
        call "Add State(s) to Queue.gvi"(State(s) in Front ("")="Data: Cleanup\nExit", State(s) in ("")=w2) -> (States Out=w7)
        w6 = s2
        w8 = default
        w9 = s1
      }
      frame "---------- Comm ----------" {
        # Template Separator
        # (You can make a copy of, or modify, this frame)
        call "Add State(s) to Queue.gvi"(State(s) in ("")=w2) -> (States Out=w7)
        w6 = s2
        w8 = default
        w9 = s1
      }
      frame "Comm: Initialize" {
        # Comm: Initialize
        # (Establishes a connection with the webserver.)
        call "Add State(s) to Queue.gvi"(State(s) in ("")=w2) -> (States Out=w7)
        # Change this according to whether it's being hosted on the Pi (e.g. localhost) or you are accessing remotely (Pi IP address)
        disable {
          frame Disabled {
            # Use to test running locally.
            w52 = "ws://192.168.1.116:6123"
          }
          frame Enabled {
            call "GetHostname"() -> (return=w53, error out=w54)
            Format Into String(formatString="ws://%s:6123", errIn=w54, w53) -> (outString=w52, errOut=w6)
          }
        }
        Property Node(instance in=s1, "WebSockets URL"=w52) -> (instance out=w9)
        w8 = default
      }
      frame "Comm: Connecting" {
        # Comm: Connecting
        # (Establish a WebSockets connection.)
        call "Add State(s) to Queue.gvi"(State(s) in ("")=w2) -> (States Out=w7)
        Property Node(instance in=s1) -> ("WebSockets URL"=w55, "WebSocket Session"=w56, instance out=w57)
        call "Close WebSocket.gvi"(websocket session in=w56, error in=s2) -> (error out=w58)
        call "Clear Error Cluster.gvi"(error in=w58) -> (error out=w59)
        call "Open WebSocket.gvi"(url=w55, error in=w59) -> (websocket session out=w60, error out=w61)
        Not(x=w61) -> w62
        Property Node(instance in=w57, "WebSocket Session"=w60, "Connected?"=w62) -> (instance out=w9)
        call "Clear Error Cluster.gvi"(error in=w61) -> (error out=w6)
        w8 = default
      }
      frame "Comm: Read" {
        Property Node(instance in=s1) -> ("WebSocket Session"=w63, instance out=w64)
        call "Read String.gvi"(websocket session in=w63, timeout=5, error in=s2) -> (websocket session out=w65, string response=w66, error out=w67)
        # Comm: Read
        # (Read any available message.)
        Select(s=w67, t="", f="Comm: Process") -> w68
        call "Add State(s) to Queue.gvi"(State(s) in Front ("")=w68, State(s) in ("")=w2) -> (States Out=w7)
        Not(x=w67) -> w69
        Property Node(instance in=w64, "WebSocket Session"=w65, "Message In"=w66, "Connected?"=w69) -> (instance out=w9)
        call "Clear Error Cluster.gvi"(error in=w67) -> (error out=w6)
        w8 = default
      }
      frame "Comm: Write" {
        # Comm: Write
        # (Write available message.)
        call "Add State(s) to Queue.gvi"(State(s) in ("")=w2) -> (States Out=w7)
        Property Node(instance in=s1) -> ("WebSocket Session"=w70, "Message Out"=w71, instance out=w72)
        call "Write String.gvi"(websocket session in=w70, string message=w71, error in=s2) -> (websocket session out=w73, error out=w74)
        Not(x=w74) -> w75
        Property Node(instance in=w72, "WebSocket Session"=w73, "Connected?"=w75) -> (instance out=w9)
        call "Clear Error Cluster.gvi"(error in=w74) -> (error out=w6)
        w8 = default
      }
      frame "Comm: Process" {
        Property Node(instance in=s1) -> ("Message In"=w76)
        Unflatten From Json(JSON string=w76, error in (no error)=s2, path=["Command"], type and defaults=string "") -> (error out=w77, value=w78)
        Format Into String(formatString="UI: Process %s", errIn=w77, w78) -> (outString=w79, errOut=w6)
        # Comm: Process
        # (Process message.)
        call "Add State(s) to Queue.gvi"(State(s) in Front ("")=w79, State(s) in ("")=w2) -> (States Out=w7)
        w8 = default
        w9 = s1
      }
    }
    next s1 = w9
    next s2 = w6
    next s3 = w7
    stop if w8
  }
